# Grasshopper definition starter.gh (Grasshopper 0.9.76)
# plug-ins: Python Interpreter

# ---- group: example
timer = Timer(TimerInterval=1, Target=[pgh_2, pgh])  # disabled
python = PythonScript()  # -> a; disabled
# ---------- python: Python ----------
from pgh.new_core import *
class Spring(object):

    # Constructor
    def __init__(self, x, y, s, d, m, k_in, others):
        self.over = False
        self.move = False
        self.velx = 0.0  # X Velocity
        self.vely = 0.0  # Y Velocity
        self.accel = 0  # Acceleration
        self.force = 0  # Force
        # Screen values
        self.xpos = x
        self.tempxpos = x
        self.ypos = y
        self.tempypos = y
        self.rest_posx = x  # Rest position X
        self.rest_posy = y  # Rest position Y
        self.size = s
        self.damp = d  # Damping
        self.mass = m  # Mass
        self.k = k_in  # Spring constant
        self.friends = others

    def update(self):
        if self.move:
            self.rest_posy = mouseY
            self.rest_posx = mouseX
        self.force = -self.k * (self.tempypos - self.rest_posy)  # f=-ky
        # Set the acceleration, f=ma == a=f/m
        self.accel = self.force / self.mass
        self.vely = self.damp * (self.vely + self.accel)  # Set the velocity
        self.tempypos = self.tempypos + self.vely  # Updated position
        self.force = -self.k * (self.tempxpos - self.rest_posx)  # f=-ky
        # Set the acceleration, f=ma == a=f/m
        self.accel = self.force / self.mass
        self.velx = self.damp * (self.velx + self.accel)  # Set the velocity
        self.tempxpos = self.tempxpos + self.velx  # Updated position
        self.over = (self.overEvent() or self.move) and not self.otherOver()

    # Test to see if mouse is over this spring
    def overEvent(self):
        disX = self.tempxpos - mouseX
        disY = self.tempypos - mouseY
        return sqrt((disX)**2 + (disY)**2) < self.size / 2

    # Make sure no other springs are active
    def otherOver(self):
        for friend in self.friends:
            if friend != self and friend.over:
                return True
        return False

    def display(self):
        if self.over:
            fill(153)
        else:
            fill(255)
        ellipse(self.tempxpos, self.tempypos, self.size, self.size)

    def pressed(self):
        self.move = self.over

    def released(self):
        self.move = False
        self.rest_posx = self.xpos
        self.rest_posy = self.ypos

a = Spring
# ---------- end python ----------
toggle = BooleanToggle(True)
pgh = Processing(RESET=toggle)  # -> out, GeoOut, ColorOut; inputs RESET: Boolean, CLASS: list
# ---------- pgh: Python ----------
if "PFLAG" not in globals():
    from pgh.new_core import *
    unIntellisense(ghenv)
else:
    ColorOut=pgh.new_core.ColorOut
    GeoOut=pgh.new_core.GeoOut
##########custom code below##########

def setup():
    global a
    a = []
    size(255,255)
    fill(200,255,100)
    ellipse(0,0,25,10)
    noStroke()
    rect(60,0,120,30)
    polygon(0,-50,5,5)
    curve(0,50,0,10,10,0,15,33,5,30,5,8,40,6,9)
    a.append(ellipse(0,100,5,5))
    beginShape()
    vertex(30, 20)
    vertex(85, 20)
    vertex(85, 99)
    vertex(30, 75)
    vertex(40,37)
    endShape()
def draw():
    
    c = color(random(255),random(255),random(255))
    if random()>0.5:
        noStroke()
    else:
        stroke(c)
    fill(c)
    rect(mouseX-10,mouseY-10,mouseX+10,mouseY+10)
##########custom code above##########
GO(ghenv)
# ---------- end pgh ----------
pgh_2 = Processing(RESET=toggle, c=ColourSwatch(SwatchColor=RGB(46, 165, 184)))  # -> out, GeoOut, ColorOut; inputs RESET: Boolean, CLASS: list, OPTION: list
# ---------- pgh_2: Python ----------
if "PFLAG" not in globals():
    from pgh.new_core import *
    unIntellisense(ghenv)
else:
    ColorOut=pgh.new_core.ColorOut
    GeoOut=pgh.new_core.GeoOut
##########custom code below##########

def setup():
    stroke(0,0,0)
    fill(c)
    ellipse(0,0,10,10)
    pushMatrix()
    pushStyle()
    fill(255,0,0)
    translate(30,30)
    ellipse(0,0,10,10)
    popMatrix()
    popStyle()
    fill(50)
    ellipse(0,0,5,10)

def draw():
    if mousePressed:
        translate(5,5)
    fill(255,0,0)
    e = ellipse(mouseX,mouseY,5,5)
##########custom code above##########
GO(ghenv)
# ---------- end pgh_2 ----------
preview = CustomPreview(Geometry=pgh_2.GeoOut, Shader=pgh_2.ColorOut)
preview_2 = CustomPreview(Geometry=pgh.GeoOut, Shader=pgh.ColorOut)

# ----
panel = Panel("Processing.gh")

# ---- group: not avaliable yet
xy = XYPlane(Origin=Point(0, 0, 0))  # disabled
option = PythonScript(
    CPLANE=xy,
    fill_color=ColourSwatch(SwatchColor=RGB(255, 255, 255)),
    stroke_color=ColourSwatch(SwatchColor=RGB(0, 0, 0)),
    stroke_weight=Slider(1, range=0..1),
    AUTO_DISPLAY=Toggle(True),
    GEOMETRY_OUTPUT=Toggle(False),
    COLOR_OUTPUT=Toggle(True),
    DYNANMIC=Toggle(False))  # -> OPTION; disabled
# ---------- option: Python ----------
import System.Drawing.Color as Color
OPTION = [CPLANE,
          fill_color,
          stroke_color,
          stroke_weight,
          AUTO_DISPLAY,
          GEOMETRY_OUTPUT,
          COLOR_OUTPUT,
          DYNANMIC]

i = ghenv.Component.Params.Input[0]

for param in ghenv.Component.Params.Input:
    access = param.Access
    for data in param.VolatileData.AllData(True):
            value = data.Value
            print value
    for branch in param.VolatileData.Branches:
        print branch
print ghenv.Component.Params.Output
print ghenv.Script.GetVariable()
print ghenv.Script.GetVariableNames()

keyPressed()
# ---------- end option ----------

# ---- group: the userobject
pgh_3 = Processing(RESET=True)  # -> out, GeoOut, ColorOut; inputs RESET: Boolean, CLASS: list
# ---------- pgh_3: Python ----------
if "PFLAG" not in globals():
    from pgh.new_core import *
else:
    ColorOut=pgh.new_core.ColorOut
    GeoOut=pgh.new_core.GeoOut
##########custom code below##########

def setup():
    pass
def draw():
    pass

##########custom code above##########
GO(ghenv)
# ---------- end pgh_3 ----------
