# Grasshopper definition unnamed.gh (Grasshopper 0.9.76)
# plug-ins: Python Interpreter

button = Button()
toggle = BooleanToggle(False)
python = PythonScript()  # -> out
# ---------- python: Python ----------
from Rhino.Geometry import *
class Particle(object):
    def __init__(self,loc,vel = Vector3d.Zero,acc = Vector3d.Zero, mass = 1):
        self.loc = loc
        self.vel = vel
        self.acc = acc
        self.mass = mass
    def update(self):
        self.vel += self.acc
        self.loc += self.vel
    def applyForces(self,forces):
        if hasattr(forces,"__iter__"):
            for f in forces:
                self.applyForces(f)
        self.acc += forces / self.mass

class ParticleSystem():
    def __init__(self,particles = []):
        self.particles = particles
    def add(self,particles):
        if hasattr(particles,"__iter__"):
            for p in particle:
                self.add(p)
        self.particles.append(particles)
    def remove(self,particle):
        self.particles.remove(particle)
    def update(self):
        for p in self.particles:
            p.update()
    def applyForces(self,forces):
        for p in self:
            p.applyForces(forces)
    def __iter__(self):
        return self.particles
        
def setup(*args,**kwargs):
    locals().update(kwargs)
    print locals()
    gl = 'my global var'
    def decorator(func):
        var = 'game'
        clvar = 333
        def wrapped():
            return func()
        return wrapped
    return decorator

def global_var(*args,**kwargs):
    def deco(fn):
        def wrapped():
            locals().update(kwargs)
            return fn()
        return wrapped
    return deco

GLOBAL_DICT = {}
def echo(a):
    print a
def setup():
    a = 222
    b = 55
    f = 666
    return(locals())
setup()

@global_var(a = 933,b='what')
def draw():
    for k,v in setup().items():
        print k,v
        exec('%s = %r'%(k,v))
    print "LOOK HERE!!!",b
    print locals()
    print 'draw test'

draw()
print 'free:',draw.__code__.co_freevars
print 'cell:',draw.__code__.co_cellvars
print draw.__closure__
for clo in draw.__closure__:
    print clo.cell_contents,1

def clear():
    for uniquevar in [var for var in globals().copy() if var[0] != "_"]:
        del globals()[uniquevar]
# ---------- end python ----------
python_2 = PythonScript(reset=button)  # -> OUTPUT, out, b; inputs reset: Boolean
# ---------- python_2: Python ----------
import rhinoscriptsyntax as rs
import scriptcontext as sc
import Rhino
import Rhino.Geometry as rg
from Rhino.Geometry import *
import Grasshopper.Kernel.Data.GH_Path as Path
import Grasshopper.DataTree as DataTree
import Grasshopper.Kernel as gh
import ghpythonlib.components as gc
import System.Drawing
import time
import math
from processing import noise
import random
import System.Drawing.Color as Color
noise = noise.SimplexNoise.noise2
color = Color.FromArgb
PI = math.pi
from processing.interact import *

# accessible global var
width = 100
height = 100
_posInfo = rs.GetCursorPos()
mouseX = _posInfo[0].X
mouseY = _posInfo[0].Y
pmouseX = mouseX
pmouseY = mouseY

## global setting
if "display" not in sc.sticky:
    sc.sticky["display"] = Rhino.Display.CustomDisplay(True)
display = sc.sticky["display"]

## display setting
DISPLAY_ALL = True
OUTPUT = []
IS_FILL = False
IS_STROKE = True
LINE_WEIGHT = 1
geometry_pipeline = []
BACKGROUND_COLOR = Color.FromArgb(255,255,255)
FILL_COLOR = Color.FromArgb(0,0,0)
STROKE_COLOR = Color.FromArgb(0,0,0)
## drawing setting
DARW_MODE = ["SCREEN","CPLANE","WORLD"]
DRAW_Count = 0
VIEWPORT = Rhino.RhinoDoc.ActiveDoc.Views.ActiveView.ActiveViewport
_CPLANE = Plane.WorldXY
_CPLANESTACK = []


# buildin func

def _clear():
    for uniquevar in [var for var in globals().copy() if var[0] != "_"]:
        del globals()[uniquevar]

def _newView(name,screenX = 0,screenY = 0):
    ls = Rhino.RhinoDoc.ActiveDoc.Views.GetViewList(True,False)
    exist = Rhino.RhinoDoc.ActiveDoc.Views.Find(name,True)
    if not exist:
        exist = Rhino.RhinoDoc.ActiveDoc.Views.Add(
        name,
        Rhino.Display.DefinedViewportProjection.Top,
        System.Drawing.Rectangle(screenX,screenY,screenX+width,screenY+height),
        True)
    return exist
def _convert_polyline(curve):
    return curve.ToPolyline(-1,-1,0.1,0,0, 0.1,0.1,0,True)

def background(c):
    BACKGROUND_COLOR = color(c)
    display.Clear()
    display.Dispose
    OUTPUT = []
def size(w,h):
    global width,height
    width = w
    height = h
def noFill():
    FILL_COLOR = Color.FromArgb(0,0,0,0)
    
def fill(a,r,g,b):
    FILL_COLOR = color(a,r,g,b)
def fill_mesh(planar_curve):
    TryGetPolyline()
    try:
        return Mesh.CreateFromClosedPolyline(planar_curve)
    except:
        planar_curve = planar_curve.ToNurbsCurve()
        return Brep.CreatePlanarBreps(planar_curve)
def fill_color():
    rg.PointCloud()
def stroke(color = FILL_COLOR,wight = LINE_WEIGHT):
    STROKE_COLOR = color
def noStroke():
    STROKE_COLOR = Color.FromArgb(0,0,0,0)
def dist(pt1,pt2):
    return pt1.DistanceTo(pt2)
# helper function for consistent api
def line(x1,y1,x2,y2):
    ln = Line(Point3d(x1,y1,0),Point3d(x2,y2,0))
    OUTPUT.append(ln)
    return ln
def rect(x1,y1,x2,y2):
    rec = Rectangle3d(_CPLANE,Point3d(x1,y1,0),Point3d(x2,y2,0))
    OUTPUT.append(rec)
    return rec
def ellipse(x,y,a,b):
    pl = Plane(_CPLANE)
    pl.Translate(Vector3d(x,y,0))
    ell = Ellipse(pl,a,b)
    OUTPUT.append(ell)
    return ell
def text():
    #! todo
    rs.AddText()
def translate(x,y,z=0):
    _CPLANE.Translate(Vector3d(x,y,z))
def strokeWeight(weight):
    LINE_WEIGHT = weight
def pushMatrix():
    _CPLANESTACK.append(_CPLANE)
def popMatrix():
    _CPLANE = _CPLANESTACK.pop() if _CPLANESTACK else Plane.WorldXY
def shape(polygon):
    #! add fiiled polygon
    display.AddPolygon(polygon.points,FILL_COLOR,STROKE_COLOR,True,True)
### help func
def constrain( pt,geo):
    Max = geo.GetBoundingBox(_CPLANE).Max
    Min = geo.GetBoundingBox(_CPLANE).Min
    pt.X = Rhino.RhinoMath.Clamp(pt.X,Min.X,Max.X)
    pt.Y = Rhino.RhinoMath.Clamp(pt.Y,Min.Y,Max.Y)
    pt.Z = Rhino.RhinoMath.Clamp(pt.Z,Min.Z,Max.Z)
    return pt

### main frame
def setting(draw_func,mode):## trace some hidden variable?
    global DRAW_Count
    DRAW_Count += 1
    if mode == CPLANE : _CPLANE.Z += 1
    time.clock()
    mouse = rs.GetCursorPos()[0]
    display.Clear()
    display.Dispose
    return draw_func

def initilize():
    global Spring2D
    class Spring2D(object):
        def __init__(self, xpos, ypos, m, g):
            # The x- and y-axis velocities
            self.vx = 0
            self.vy = 0
            # The x- and y-coordinates
            self.x = xpos
            self.y = ypos
            self.radius = 30
            self.stiffness = 0.2
            self.damping = 0.7
            self.mass = m
            self.gravity = g
    
        def update(self, targetX, targetY):
            forceX = (targetX - self.x) * self.stiffness
            ax = forceX / self.mass
            self.vx = self.damping * (self.vx + ax)
            self.x += self.vx
            forceY = (targetY - self.y) * self.stiffness
            forceY += self.gravity
            ay = forceY / self.mass
            self.vy = self.damping * (self.vy + ay)
            self.y += self.vy
    
        def display(self, nx, ny):
            noStroke()
            ellipse(self.x, self.y, self.radius * 2, self.radius * 2)
            stroke(255)
            line(self.x, self.y, nx, ny)

def setup():
    size(640, 800)
    _newView('processing')
    global s1,s2,gravity,mass
    s1 = None
    s2 = None
    gravity = 9.0
    mass = 2.0

    # Inputs: x, y, mass, gravity
    s1 = Spring2D(0.0, width / 2, mass, gravity)
    s2 = Spring2D(0.0, width / 2, mass, gravity)

"""
test here
"""


#@setting
def draw():
    background(0)
    b  = _convert_polyline(ellipse(10,10,5,8).ToNurbsCurve())
    print b.TryGetPolyline()
    pl = b.TryGetPolyline()[1]
    FILL_COLOR = Color.FromArgb(255,255,255,120)
    display.AddPolygon(pl.ToArray(),FILL_COLOR,STROKE_COLOR,True,True)
    print s1
    s1.update(mouseX, mouseY)
    s1.display(mouseX, mouseY)
    s2.update(s1.x, s1.y)
    s2.display(s1.x, s1.y)

ghenv.Component.Params.Input[0].Name = 'reset'
ghenv.Component.Params.Input[0].NickName = 'reset'

def variables(func):
    pass

if reset:
	initilize()
	setup()
else:
    draw()

print draw.__closure__
def callBack(kp,mp):
    if keyPressed:
        kp()
    if mousePressed:
        mp()
# ---------- end python_2 ----------
python_3 = PythonScript(reset=button)  # -> out, b; inputs reset: Boolean; disabled
# ---------- python_3: Python ----------
import rhinoscriptsyntax as rs
import scriptcontext as sc
import Rhino
import Rhino.Geometry as rg
from Rhino.Geometry import *
import Grasshopper.Kernel.Data.GH_Path as Path
import Grasshopper.DataTree as DataTree
import Grasshopper.Kernel as gh
import ghpythonlib.components as gc
import System.Drawing
import time
import math
from processing import perlin
import random
import System.Drawing.Color as Color
noise = perlin.SimplexNoise.noise2
color = Color.FromArgb
PI = math.pi
from processing.interact import *


# accessible global var
width = 100
height = 100
_posInfo = rs.GetCursorPos()
mouseX = _posInfo[0].X
mouseY = _posInfo[0].Y
pmouseX = mouseX
pmouseY = mouseY

## global setting
if "display" not in sc.sticky:
    sc.sticky["display"] = Rhino.Display.CustomDisplay(True)
display = sc.sticky["display"]

## display setting
LINE_WEIGHT = 1
DISPLAY_COLOR = Color.FromArgb(0,0,0)
BACKGROUND_COLOR = Color.FromArgb(255,255,255)
geometry_pipeline = []
## drawing setting
DARW_MODE = ["SCREEN","CPLANE","WORLD"]
DRAW_Count = 0
VIEWPORT = ghdoc.Views.ActiveView.ActiveViewport
_CPLANE = Plane.WorldXY
_CPLANESTACK = []


# buildin func
def _newView(name,screenX = 0,screenY = 0):
    ls = Rhino.RhinoDoc.ActiveDoc.Views.GetViewList(True,False)
    exist = Rhino.RhinoDoc.ActiveDoc.Views.Find(name,True)
    if not exist:
        exist = Rhino.RhinoDoc.ActiveDoc.Views.Add(
        name,
        Rhino.Display.DefinedViewportProjection.Top,
        System.Drawing.Rectangle(screenX,screenY,screenX+width,screenY+height),
        True)
    return exist


def background(color):
    display.Clear()
    display.Dispose
def size(w,h):
    global width,height
    width = w
    height = h
def fill(planar_curve):
    
    try:
        return Mesh.CreateFromClosedPolyline(planar_curve)
    except:
        planar_curve = planar_curve.ToNurbsCurve()
        return Brep.CreatePlanarBreps(planar_curve)
def stroke(crv,color = DISPLAY_COLOR,wight = LINE_WEIGHT):
    display.AddCurve(crv,sw,weight)

# helper function for consistent api
def rect(x1,y1,x2,y2):
    return Rectangle3d(_CPLANE,Point3d(x1,y1,0),Point3d(x2,y2,0))
def ellipse(x,y,a,b):
    pl = Plane(_CPLANE)
    pl.Translate(Vector3d(x,y,0))
    return Ellipse(pl,a,b)
def text():
    #! todo
    rs.AddText()
def translate(x,y,z=0):
    _CPLANE.Translate(Vector3d(x,y,z))
def strokeWeight(weight):
    LINE_WEIGHT = weight
def pushMatrix():
    _cplaneStack.append(_CPLANE)
def popMatrix():
    _CPLANE = _cplaneStack.pop() if _cplaneStack else Plane.WorldXY

### help func
def constrain( pt,geo):
    Max = geo.GetBoundingBox(_CPLANE).Max
    Min = geo.GetBoundingBox(_CPLANE).Min
    pt.X = Rhino.RhinoMath.Clamp(pt.X,Min.X,Max.X)
    pt.Y = Rhino.RhinoMath.Clamp(pt.Y,Min.Y,Max.Y)
    pt.Z = Rhino.RhinoMath.Clamp(pt.Z,Min.Z,Max.Z)
    return pt

### main frame
def setting(draw_func,mode):## trace some hidden variable?
    global DRAW_Count
    DRAW_Count += 1
    if mode == CPLANE : _CPLANE.Z += 1
    time.clock()
    mouse = rs.GetCursorPos()[0]
    display.Clear()
    display.Dispose
    return draw_func

def initilize():
    #define class here for better tweaking
    pass

def setup():
    size(600,800)
    win = _newView('processing')
    global a,b
    a = ellipse(3,10,2,5)
    print a
    #initilize var here when click reset button (with global key word)
    pass

#@setting
def draw():
    global a,b
    a = rect(10,5,30,20)
    b = fill(a)
    #constantly do some thing when the timer is on
    pass
ghenv.Component.Params.Input[0].Name = 'reset'
ghenv.Component.Params.Input[0].NickName = 'reset'

def variables(func):
    pass

if reset:
	initilize()
	setup()
else:
    draw()

print draw.__closure__
def callBack(kp,mp):
    if keyPressed:
        kp()
    if mousePressed:
        mp()
# ---------- end python_3 ----------
python_4 = PythonScript()  # -> out, a
# ---------- python_4: Python ----------
from pgh.core import *
background(200)
print FILL_COLOR
print BACKGROUND_COLOR
# ---------- end python_4 ----------
timer = Timer(TimerInterval=10, Target=[python_3, python_2])  # disabled
